% Simulink data dictionary sldemo_fuelsys_original.sldd

AF_sensor_tol = 1

EngSensors = Simulink.Bus()
  throttle: s16En3, Unit="deg"
  speed: s16En3, Unit="rad/s"
  ego: s16En7, Unit="V"
  map: u8En7, Unit="bar"

MAF_sensor_tol = 1
ego_sw = 1
fault_time = 50
fuel_inj_tol = 1
hys = 25
kappa_tol = 1
ki = 0.14
kp = 0.04
map_sw = 1
max_ego = 1.2
max_press = 0.95
max_rob = 20
max_speed = 628
max_throt = 90
mdl = "sldemo_fuelsys_original"
min_press = 0.05
min_throt = 3
pump_tol = 1
s16En15 = Simulink.NumericType(DataTypeMode="Single", SignednessBool=true, WordLength=32, FixedExponent=0)
s16En3 = Simulink.NumericType(DataTypeMode="Single", SignednessBool=true, WordLength=32, FixedExponent=0)
s16En7 = Simulink.NumericType(DataTypeMode="Single", SignednessBool=true, WordLength=32, FixedExponent=0)
speed_sw = 1
st_range = 0.0001
tau_ww_tol = 1
throttle_sw = 1
u8En7 = Simulink.NumericType(DataTypeMode="Single", SignednessBool=true, WordLength=32, FixedExponent=0)
zero_thresh = 250
tspan = 30